# Grasshopper definition honeybee_shoebox.gh (Grasshopper 1.0.7)
# plug-ins: FalseStartToggle

box_2pt = Box2Pt(PointA="0,0,0", PointB="10,10,3", Plane=PlaneXY(0, 0, 0))
roomsolid = HBRoomFromSolid(geo=flatten(box_2pt), conditioned=True)  # -> out, rooms; plug-in component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
aperturesbyratio = HBAperturesByRatio(hb_objs=flatten(roomsolid.rooms), ratio="0.5", subdivide=Toggle(False))  # -> out, hb_objs; plug-in component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
model = HBModel(rooms=flatten(aperturesbyratio.hb_objs), name="HB Shoebox")  # -> out, model; plug-in component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
false_start_toggle = FalseStartToggle(False)
dumpobjects = HBDumpObjects(
    hb_objs=flatten(model.model),
    name="HB Shoebox",
    folder="C:\GitHub\designbuilder_schema\honeybee_to_designbuilder",
    indent="4",
    dump=false_start_toggle)  # -> out, hb_file; plug-in component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
vizbytype = HBVisualizeByType(hb_objs=model.model)  # -> walls, interior_walls, roofs, ceilings, exterior_floors, interior_floors, air_walls, apertures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; plug-in component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
